# Grasshopper definition diamonds.gh (Grasshopper 1.0.7)

diamondfaces = GetInteger(Slider(28, range=0..100), AtLeast=1, AtMost=1, Maximum=2147483647, Minimum=-2147483648)
count = GetInteger(Slider(36, range=0..100), AtLeast=1, AtMost=1, Maximum=2147483647, Minimum=-2147483648)
number_slider = Slider(100, range=0..100)
box = CenterBox(Base=PlaneXY(0, 0, 0), X=number_slider, Y=number_slider, Z=number_slider)
pop3d = Populate3D(Region=box, Count=count, Seed=1)
xy = XYPlane(Origin=flatten(pop3d))
msphere = MeshSphere(Base=xy, Radius=10, UCount=10, VCount=20)
popgeo = PopulateGeometry(Geometry=msphere, Count=diamondfaces, Seed=1)  # -> simplify(Population)
facet = FacetDome(Points=popgeo)  # -> simplify(Pattern), Dome
boundary = BoundarySurfaces(Edges=facet.Pattern)
tstat = TreeStatistics(Tree=boundary)  # -> Paths, Length, Count
range = Range(Domain=Domain(0, 1), Steps=tstat.Count)
mjoin = MeshJoin(Meshes=boundary)  # -> flatten(Mesh)
gradient = Gradient(
    LowerLimit=0,
    UpperLimit=1,
    Parameter=range,
    stops=[0.16: RGB(189, 187, 220), 0.496: RGB(55, 96, 160), 0.85: RGB(24, 0, 40)])
weld = WeldMesh(Mesh=mjoin, Angle=3.141592654)
c_script = CSharpScript(mesh=weld, color=gradient)  # -> out, A; inputs mesh: Mesh, color: Color
# ---------- c_script: C# ----------
    var c = color.R + "," + color.G + "," + color.B;
    mesh.SetUserString("color", c);
    A = mesh;
# ---------- end c_script ----------

# ---- group: RH_OUT: meshes
mesh = Mesh(flatten(c_script.A))
